# Grasshopper definition Bone-Tissue.gh (Grasshopper 1.0.7)
# plug-ins: Weaverbird

geometry = Geometry(<brep referenced from the Rhino model>)
volume = Volume(Geometry=geometry)  # -> Volume, Centroid
populate_3d = Populate3D(Region=geometry, Count=Slider(55, range=0..100), Seed=Slider(4, range=1..10))
scale = Scale(Geometry=geometry, Center=volume.Centroid, Factor=Slider(0.9, range=0..1))  # -> Geometry, Transform
voronoi_3d = Voronoi3D(Points=populate_3d, Box=geometry)  # -> Cells, Boundary
deconstruct_brep = DeconstructBrep(Brep=voronoi_3d.Cells)  # -> Faces, Edges, Vertices
area = Area(Geometry=deconstruct_brep.Faces)  # -> Area, Centroid
point_in_brep = PointInBrep(Brep=scale.Geometry, Point=area.Centroid, Strict=False)
cull_pattern = CullPattern(List=deconstruct_brep.Faces, CullPattern=point_in_brep)
brep_join = BrepJoin(Breps=cull_pattern)  # -> flatten(Breps), Closed

volume_2 = Volume(Geometry=voronoi_3d.Cells)  # -> Volume, Centroid
vector_2pt = Vector2Pt(PointA=volume.Centroid, PointB=volume_2.Centroid, Unitize=False)  # -> Vector, Length
amplitude = Amplitude(Vector=vector_2pt.Vector, Amplitude=Slider(2, range=1..5))
move = Move(Geometry=brep_join.Breps, Motion=amplitude)  # -> Geometry, Transform
deconstruct_brep_2 = DeconstructBrep(Brep=move.Geometry)  # -> Faces, Edges, Vertices
discontinuity = Discontinuity(Curve=deconstruct_brep_2.Faces, Level=1)  # -> Points, Parameters
polyline = PolyLine(Vertices=discontinuity.Points, Closed=Toggle(True))  # -> flatten(Polyline)
area_2 = Area(Geometry=polyline)  # -> Area, Centroid
sort_list = SortList(Keys=area_2.Area, ValuesValuesA=polyline)  # -> Keys, ValuesValuesA
dispatch = Dispatch(List=sort_list.ValuesValuesA, DispatchPattern=[True, False])  # -> ListA, ListB
area_3 = Area(Geometry=dispatch.ListA)  # -> Area, Centroid
area_4 = Area(Geometry=dispatch.ListB)  # -> Area, Centroid
vector_2pt_2 = Vector2Pt(PointA=area_3.Centroid, PointB=area_4.Centroid, Unitize=False)  # -> Vector, Length
move_2 = Move(Geometry=dispatch.ListA, Motion=vector_2pt_2.Vector)  # -> graft(Geometry), Transform
geometry_2 = Geometry(graft(dispatch.ListA))
geometry_3 = Geometry(move_2.Geometry)
loft = Loft(
    Curves=[geometry_2, geometry_3],
    Options={Adjust=False, Closed=False, LoftEnds=0, LoftSimp=0, LoftType=0, Rebuild=10, Refit=0.01})
number_slider = Slider(1, range=0..1)
deconstruct_brep_3 = DeconstructBrep(Brep=loft)  # -> Faces, Edges, Vertices
mesh_surface = MeshSurface(Surface=deconstruct_brep_3.Faces, UCount=number_slider, VCount=number_slider, Overhang=True, Equalize=False)  # -> flatten(Mesh)
weaverbird_s_join_meshes_and_weld = WeaverbirdsJoinMeshesAndWeld(Mesh=mesh_surface, Weld=False)
weaverbird_s_catmull_clark_subdivision = WeaverbirdsCatmullClarkSubdivision(MeshCurves=weaverbird_s_join_meshes_and_weld, Level=Slider(3, range=0..10), SmoothNakedEdges=1)
weaverbird_s_mesh_thicken = WeaverbirdsMeshThicken(MeshCurves=weaverbird_s_catmull_clark_subdivision, Distance=Slider(1, range=0..1), OffsetType=0)
custom_preview = CustomPreview(Geometry=weaverbird_s_mesh_thicken, Material=ColourSwatch(SwatchColor=RGB(85, 78, 158)))
